% Simulink data dictionary data.sldd

servoPins = struct(
  aileron=struct(left=9, right=10),
  elevator=struct(left=7, right=8),
  rudder=11,
  flap=struct(left=5, right=6))

envConsts = struct(magVar=-1.3, refHeight=0)

Uplink = Simulink.Bus()
  AutoflightRefValues: Bus: AutoflightDemandedValues
  Override: boolean
  ControlOverride: Bus: ControlOverrides

Demands = Simulink.Bus()
  FlightMode: Bus: FlightMode
  Altitude: single, Unit="m"
  Heading: single, Unit="deg"
  Override: boolean
  ControlOverrides: Bus: ControlOverrides

AutoflightDemandedValues = Simulink.Bus()
  FlightMode: Bus: FlightMode
  HoldAltitude: single, Unit="m"
  HoldHeading: single, Unit="deg"

ControlOverrides = Simulink.Bus()
  Aileron: single
  Elevator: single
  Flap: single
  Throttle: single
  Rudder: single

Commands = Simulink.Bus()
  Aileron: single, Unit="deg"
  Elevator: single, Unit="deg"
  Flap: single, Unit="deg"
  Throttle: single
  Rudder: single, Unit="deg"

actuatorCentres = struct(
  aileron=struct(left=single(0), right=single(0)),
  elevator=struct(right=single(0), left=single(0)),
  flap=struct(left=single(0), right=single(0)),
  rudder=single(0))

deflectionLimits = struct(
  aileron=struct(min=single(-10), max=single(10)),
  elevator=struct(max=single(10), min=single(-10)),
  flap=struct(max=single(15), min=single(0)),
  rudder=struct(min=single(-5), max=single(5)))

sensorSampleTime = Simulink.Parameter(0.02)
loggingSampleTime = Simulink.Parameter(1)
SecArd = 0

Variants = Simulink.VariantConfigurationData(
  VariantConfigurations=[struct(
    Name="No_Secondary_HIL",
    Description="",
    ControlVariables=[struct(Name="SimType", Value="1", Source="data.sldd"), struct(Name="SecArd", Value="0", Source="data.sldd")],
    SubModelConfigurations=[]), struct(
    Name="With_Secondary_HIL",
    Description="",
    ControlVariables=[struct(Name="SimType", Value="1", Source="data.sldd"), struct(Name="SecArd", Value="1", Source="data.sldd")],
    SubModelConfigurations=[]), struct(
    Name="MIL",
    Description="",
    ControlVariables=[struct(Name="SimType", Value="0", Source="data.sldd"), struct(Name="SecArd", Value="0", Source="data.sldd")],
    SubModelConfigurations=[])],
  DefaultConfigurationName="MIL")

sensorSystemMatrix = [1 0 0 0.02 0 0 0.0002 0 0 0 0 0 0 0 0
 0 1 0 0 0.02 0 0 0.0002 0 0 0 0 0 0 0
 0 0 1 0 0 0.02 0 0 0.0002 0 0 0 0 0 0
 0 0 0 1 0 0 0.02 0 0 0 0 0 0 0 0
 0 0 0 0 1 0 0 0.02 0 0 0 0 0 0 0
 0 0 0 0 0 1 0 0 0.02 0 0 0 0 0 0
 0 0 0 0 0 0 1 0 0 0 0 0 0 0 0
 0 0 0 0 0 0 0 1 0 0 0 0 0 0 0
 0 0 0 0 0 0 0 0 1 0 0 0 0 0 0
 0 0 0 0 0 0 0 0 0 1 0 0 0.02 0 0
 0 0 0 0 0 0 0 0 0 0 1 0 0 0.02 0
 0 0 0 0 0 0 0 0 0 0 0 1 0 0 0.02
 0 0 0 0 0 0 0 0 0 0 0 0 1 0 0
 0 0 0 0 0 0 0 0 0 0 0 0 0 1 0
 0 0 0 0 0 0 0 0 0 0 0 0 0 0 1]

sensorControlMatrix = [0 0 0
 0 0 0
 0 0 0
 0 0 0
 0 0 0
 0 0 0
 1 0 0
 0 1 0
 0 0 1
 0 0 0
 0 0 0
 0 0 0
 0 0 0
 0 0 0
 0 0 0]

vehicle = struct(
  mass=1.5,
  inertia=[0.0521 0 0; 0 0.1175 0; 0 0 0.164],
  wingspan=1.8,
  wingarea=0.1654,
  aclength=1.257,
  CG=[0.4 0 0],
  CP=[0.01 0 -0.001],
  stallSpeed=7.5,
  thrust=7.5619,
  cbar=0.1862)

FlightMode = Simulink.Bus()
  AltHold: single
  HdgHold: single

Sensors = Simulink.Bus()
  X_e: single[3], Unit="m"
  V_e: single[3], Unit="m/s"
  phi_theta_psi: single[3], Unit="rad"
  pqr: single[3], Unit="rad/s"

States = Simulink.Bus()
  phi_theta_psi: double[3], Unit="rad"
  pqr: double[3], Unit="rad/s"
  omega_dot: double[3], Unit="rad/s^2"
  X_e: double[3], Unit="m"
  V_b: double[3], Unit="m/s"
  A_be: double[3], Unit="m/s^2"
  V_e: double[3], Unit="m/s"

ActuatorStates = Simulink.Bus()
  Aileron: double, Unit="deg"
  Elevator: double, Unit="deg"
  Rudder: double, Unit="deg"
  Flap: double, Unit="deg"

SimType = 0

datcom1 = {struct(
  case="FLAPS: UAV",
  mach=0.05,
  alt=100,
  alpha=[-14 -12 -10 -8 -6 -5 -4 -2 -1 0 1 2 4 5 8 10 12 14 16 18],
  nmach=1,
  nalt=1,
  nalpha=20,
  rnnub=[],
  hypers=false,
  loop=1,
  sref=3.561,
  cbar=0.613,
  blref=5.91,
  dim="ft",
  deriv="deg",
  stmach=0.6,
  tsmach=1.4,
  save=false,
  stype=[],
  trim=false,
  damp=true,
  build=1,
  part=false,
  highsym=true,
  highasy=false,
  highcon=false,
  tjet=false,
  hypeff=false,
  lb=false,
  pwr=false,
  grnd=false,
  wsspn=2.6575,
  hsspn=1,
  ndelta=5,
  delta=[0 5 10 15 20],
  deltal=[],
  deltar=[],
  ngh=0,
  grndht=[],
  config=struct(downwash=false, body=true, wing=true, htail=false, vtail=false, vfin=false),
  version=1976,
  cd=[0.062; 0.046; 0.033; 0.025; 0.02; 0.018; 0.018; 0.019; 0.021; 0.023; 0.027; 0.031; 0.043; 0.05; 0.079; 0.102; 0.121; 0.138; 0.15; 0.146],
  cl=[-0.956; -0.762; -0.569; -0.38; -0.198; -0.109; -0.022; 0.152; 0.242; 0.335; 0.43; 0.526; 0.724; 0.825; 1.131; 1.32; 1.467; 1.582; 1.659; 1.63],
  cm=[-0.1875; -0.1644; -0.1423; -0.1214; -0.1016; -0.0922; -0.0831; -0.0653; -0.0564; -0.0475; -0.0387; -0.0298; -0.0122; -0.0035; 0.0221; 0.0375; 0.0496; 0.0593; 0.0663; NaN],
  cn=[-0.943; -0.754; -0.566; -0.38; -0.198; -0.11; -0.023; 0.151; 0.242; 0.335; 0.43; 0.527; 0.725; 0.826; 1.131; 1.318; 1.46; 1.569; 1.637; 1.596],
  ca=[-0.171; -0.114; -0.066; -0.028; -0.001; 0.009; 0.016; 0.024; 0.025; 0.023; 0.019; 0.013; -0.008; -0.022; -0.079; -0.129; -0.186; -0.249; -0.313; -0.365],
  xcp=[0.199; 0.218; 0.251; 0.319; 0.512; 0.838; 3.562; -0.432; -0.233; -0.142; -0.09; -0.057; -0.017; -0.004; 0.02; 0.028; 0.034; 0.038; 0.041; NaN],
  cma=[0.01181; 0.0113; 0.01076; 0.01018; 0.009573; 0.009256; 0.00902; 0.008885; 0.008892; 0.008885; 0.008866; 0.008832; 0.008732; 0.008662; 0.008044; 0.006885; 0.005451; 0.004174; 0.00283; NaN],
  cyb=repmat(0, 20, 1),
  cnb=repmat(0.003032, 20, 1),
  clb=[-2.971e-5; -0.0001041; -0.0001777; -0.0002497; -0.0003196; -0.0003535; -0.0003866; -0.000453; -0.0004876; -0.0005231; -0.0005593; -0.0005961; -0.0006716; -0.0007101; -0.0008272; -0.0008995; -0.0009555; -0.0009995; -0.001029; -0.001018],
  cla=[0.09794; 0.09684; 0.09529; 0.09285; 0.08962; 0.0877; 0.08677; 0.08936; 0.09165; 0.09375; 0.09564; 0.09729; 0.1; 0.101; 0.09766; 0.08397; 0.06542; 0.0481; 0.01206; -0.04113],
  clq=repmat(0.03131, 20, 1),
  cmq=repmat(-0.003822, 20, 1),
  clad=[NaN; 99999; 99999; 99999; 99999; 99999; 99999; 99999; 99999; 99999; 99999; 99999; 99999; 99999; 99999; 99999; 99999; 99999; 99999; 99999],
  cmad=[NaN; 99999; 99999; 99999; 99999; 99999; 99999; 99999; 99999; 99999; 99999; 99999; 99999; 99999; 99999; 99999; 99999; 99999; 99999; 99999],
  clp=[-0.009564; -0.00944; -0.009277; -0.009031; -0.008712; -0.008525; -0.008434; -0.008687; -0.00891; -0.009116; -0.009303; -0.009467; -0.009745; -0.00985; -0.009557; -0.008256; -0.00648; -0.004821; -0.001343; 0.003814],
  cyp=[0.0008893; 0.0007086; 0.0005306; 0.0003562; 0.0001862; 0.0001029; 2.101e-5; -0.0001432; -0.0002277; -0.0003135; -0.0004006; -0.0004889; -0.0006689; -0.0007606; -0.001051; -0.001257; -0.001448; -0.001621; -0.00185; -0.00198],
  cnp=[0.000975; 0.0007793; 0.0005871; 0.0003985; 0.0002116; 0.0001181; 2.432e-5; -0.0001626; -0.0002562; -0.0003491; -0.0004419; -0.0005346; -0.0007218; -0.0008172; -0.001161; -0.001501; -0.001871; -0.002216; -0.002712; -0.002842],
  cnr=[-0.0003259; -0.0002311; -0.0001585; -0.0001078; -7.788e-5; -7.018e-5; -6.696e-5; -7.336e-5; -8.347e-5; -9.865e-5; -0.0001192; -0.0001453; -0.0002153; -0.0002595; -0.0004294; -0.0005608; -0.0006766; -0.000776; -0.0008471; -0.00082],
  clr=[-0.003755; -0.00299; -0.002234; -0.001494; -0.0007756; -0.0004272; -8.691e-5; 0.0005962; 0.0009518; 0.001316; 0.001688; 0.002067; 0.002843; 0.003238; 0.004442; 0.005185; 0.005761; 0.006212; 0.006516; 0.006402],
  dcl_sym=[0; 0.121; 0.242; 0.353; 0.384],
  dcm_sym=[0; -0.0077; -0.0154; -0.0199; -0.0391],
  dclmax_sym=[0; 0.076; 0.147; 0.205; 0.254],
  dcdmin_sym=[0; 0.00321; 0.0079; 0.01688; 0.02426],
  clad_sym=repmat(NaN, 5, 1),
  cha_sym=[-0.008544; 99999; 99999; 99999; 99999],
  chd_sym=[-0.01604; -0.01604; -0.01604; -0.01608; -0.0163],
  dcdi_sym=[-1.65e-5 -0.00719 -0.0123 -0.0152 -0.0156
   -1.33e-5 -0.00559 -0.00909 -0.0105 -0.0105
   -1.0e-5 -0.00398 -0.00588 -0.00578 -0.00543
   -6.83e-6 -0.00238 -0.00267 -0.0011 -0.000328
   -3.62e-6 -0.000771 0.000542 0.00359 0.00478
   -2.02e-6 3.14e-5 0.00215 0.00593 0.00733
   -4.12e-7 0.000834 0.00375 0.00828 0.00988
   2.8e-6 0.00244 0.00696 0.013 0.015
   4.4e-6 0.00324 0.00857 0.0153 0.0175
   6.01e-6 0.00404 0.0102 0.0176 0.0201
   7.61e-6 0.00485 0.0118 0.02 0.0226
   9.22e-6 0.00565 0.0134 0.0223 0.0252
   1.24e-5 0.00725 0.0166 0.027 0.0303
   1.4e-5 0.00806 0.0182 0.0294 0.0329
   1.89e-5 0.0105 0.023 0.0364 0.0405
   2.2e-5 0.0121 0.0262 0.0411 0.0456
   2.53e-5 0.0137 0.0294 0.0458 0.0507
   2.84e-5 0.0153 0.0326 0.0504 0.0558
   3.17e-5 0.0169 0.0359 0.0551 0.0609
   3.49e-5 0.0185 0.0391 0.0598 0.066]), struct(
  case="AILERONS: UAV",
  mach=0.05,
  alt=100,
  alpha=[-14 -12 -10 -8 -6 -5 -4 -2 -1 0 1 2 4 5 8 10 12 14 16 18],
  nmach=1,
  nalt=1,
  nalpha=20,
  rnnub=[],
  hypers=false,
  loop=1,
  sref=3.561,
  cbar=0.613,
  blref=5.91,
  dim="ft",
  deriv="deg",
  stmach=0.6,
  tsmach=1.4,
  save=false,
  stype=4,
  trim=false,
  damp=true,
  build=1,
  part=false,
  highsym=false,
  highasy=true,
  highcon=false,
  tjet=false,
  hypeff=false,
  lb=false,
  pwr=false,
  grnd=false,
  wsspn=2.6575,
  hsspn=1,
  ndelta=9,
  delta=[],
  deltal=[-32 -20 -10 -5 0 5 10 20 32],
  deltar=[32 20 10 5 0 -5 -10 -20 -32],
  ngh=0,
  grndht=[],
  config=struct(downwash=false, body=true, wing=true, htail=false, vtail=false, vfin=false),
  version=1976,
  cd=[0.062; 0.046; 0.033; 0.025; 0.02; 0.018; 0.018; 0.019; 0.021; 0.023; 0.027; 0.031; 0.043; 0.05; 0.079; 0.102; 0.121; 0.138; 0.15; 0.146],
  cl=[-0.956; -0.762; -0.569; -0.38; -0.198; -0.109; -0.022; 0.152; 0.242; 0.335; 0.43; 0.526; 0.724; 0.825; 1.131; 1.32; 1.467; 1.582; 1.659; 1.63],
  cm=[-0.1875; -0.1644; -0.1423; -0.1214; -0.1016; -0.0922; -0.0831; -0.0653; -0.0564; -0.0475; -0.0387; -0.0298; -0.0122; -0.0035; 0.0221; 0.0375; 0.0496; 0.0593; 0.0663; NaN],
  cn=[-0.943; -0.754; -0.566; -0.38; -0.198; -0.11; -0.023; 0.151; 0.242; 0.335; 0.43; 0.527; 0.725; 0.826; 1.131; 1.318; 1.46; 1.569; 1.637; 1.596],
  ca=[-0.171; -0.114; -0.066; -0.028; -0.001; 0.009; 0.016; 0.024; 0.025; 0.023; 0.019; 0.013; -0.008; -0.022; -0.079; -0.129; -0.186; -0.249; -0.313; -0.365],
  xcp=[0.199; 0.218; 0.251; 0.319; 0.512; 0.838; 3.562; -0.432; -0.233; -0.142; -0.09; -0.057; -0.017; -0.004; 0.02; 0.028; 0.034; 0.038; 0.041; NaN],
  cma=[0.01181; 0.0113; 0.01076; 0.01018; 0.009573; 0.009256; 0.00902; 0.008885; 0.008892; 0.008885; 0.008866; 0.008832; 0.008732; 0.008662; 0.008044; 0.006885; 0.005451; 0.004174; 0.00283; NaN],
  cyb=repmat(0, 20, 1),
  cnb=repmat(0.003032, 20, 1),
  clb=[-2.971e-5; -0.0001041; -0.0001777; -0.0002497; -0.0003196; -0.0003535; -0.0003866; -0.000453; -0.0004876; -0.0005231; -0.0005593; -0.0005961; -0.0006716; -0.0007101; -0.0008272; -0.0008995; -0.0009555; -0.0009995; -0.001029; -0.001018],
  cla=[0.09794; 0.09684; 0.09529; 0.09285; 0.08962; 0.0877; 0.08677; 0.08936; 0.09165; 0.09375; 0.09564; 0.09729; 0.1; 0.101; 0.09766; 0.08397; 0.06542; 0.0481; 0.01206; -0.04113],
  clq=repmat(0.03131, 20, 1),
  cmq=repmat(-0.003822, 20, 1),
  clad=[NaN; 99999; 99999; 99999; 99999; 99999; 99999; 99999; 99999; 99999; 99999; 99999; 99999; 99999; 99999; 99999; 99999; 99999; 99999; 99999],
  cmad=[NaN; 99999; 99999; 99999; 99999; 99999; 99999; 99999; 99999; 99999; 99999; 99999; 99999; 99999; 99999; 99999; 99999; 99999; 99999; 99999],
  clp=[-0.009564; -0.00944; -0.009277; -0.009031; -0.008712; -0.008525; -0.008434; -0.008687; -0.00891; -0.009116; -0.009303; -0.009467; -0.009745; -0.00985; -0.009557; -0.008256; -0.00648; -0.004821; -0.001343; 0.003814],
  cyp=[0.0008893; 0.0007086; 0.0005306; 0.0003562; 0.0001862; 0.0001029; 2.101e-5; -0.0001432; -0.0002277; -0.0003135; -0.0004006; -0.0004889; -0.0006689; -0.0007606; -0.001051; -0.001257; -0.001448; -0.001621; -0.00185; -0.00198],
  cnp=[0.000975; 0.0007793; 0.0005871; 0.0003985; 0.0002116; 0.0001181; 2.432e-5; -0.0001626; -0.0002562; -0.0003491; -0.0004419; -0.0005346; -0.0007218; -0.0008172; -0.001161; -0.001501; -0.001871; -0.002216; -0.002712; -0.002842],
  cnr=[-0.0003259; -0.0002311; -0.0001585; -0.0001078; -7.788e-5; -7.018e-5; -6.696e-5; -7.336e-5; -8.347e-5; -9.865e-5; -0.0001192; -0.0001453; -0.0002153; -0.0002595; -0.0004294; -0.0005608; -0.0006766; -0.000776; -0.0008471; -0.00082],
  clr=[-0.003755; -0.00299; -0.002234; -0.001494; -0.0007756; -0.0004272; -8.691e-5; 0.0005962; 0.0009518; 0.001316; 0.001688; 0.002067; 0.002843; 0.003238; 0.004442; 0.005185; 0.005761; 0.006212; 0.006516; 0.006402],
  clroll=[-0.093731; -0.079061; -0.046251; -0.023126; 0; 0.023126; 0.046251; 0.079061; 0.093731],
  cn_asy=[-0.01072 -0.00904 -0.005288 -0.002644 0 0.002644 0.005288 0.00904 0.01072
   -0.008534 -0.007199 -0.004211 -0.002106 0 0.002106 0.004211 0.007199 0.008534
   -0.006376 -0.005378 -0.003146 -0.001573 0 0.001573 0.003146 0.005378 0.006376
   -0.004263 -0.003596 -0.002103 -0.001052 0 0.001052 0.002103 0.003596 0.004263
   -0.002214 -0.001867 -0.001092 -0.0005462 0 0.0005462 0.001092 0.001867 0.002214
   -0.001219 -0.001029 -0.0006017 -0.0003008 0 0.0003008 0.0006017 0.001029 0.001219
   -0.0002481 -0.0002092 -0.0001224 -6.12e-5 0 6.12e-5 0.0001224 0.0002092 0.0002481
   0.001702 0.001435 0.0008396 0.0004198 0 -0.0004198 -0.0008396 -0.001435 -0.001702
   0.002716 0.002291 0.00134 0.0006702 0 -0.0006702 -0.00134 -0.002291 -0.002716
   0.003756 0.003168 0.001853 0.0009267 0 -0.0009267 -0.001853 -0.003168 -0.003756
   0.004818 0.004064 0.002377 0.001189 0 -0.001189 -0.002377 -0.004064 -0.004818
   0.0059 0.004976 0.002911 0.001456 0 -0.001456 -0.002911 -0.004976 -0.0059
   0.008114 0.006844 0.004004 0.002002 0 -0.002002 -0.004004 -0.006844 -0.008114
   0.009242 0.007795 0.00456 0.00228 0 -0.00228 -0.00456 -0.007795 -0.009242
   0.01268 0.01069 0.006256 0.003128 0 -0.003128 -0.006256 -0.01069 -0.01268
   0.0148 0.01248 0.007302 0.003651 0 -0.003651 -0.007302 -0.01248 -0.0148
   0.01644 0.01387 0.008113 0.004057 0 -0.004057 -0.008113 -0.01387 -0.01644
   0.01773 0.01496 0.008749 0.004375 0 -0.004375 -0.008749 -0.01496 -0.01773
   0.0186 0.01569 0.009177 0.004589 0 -0.004589 -0.009177 -0.01569 -0.0186
   0.01827 0.01541 0.009016 0.004508 0 -0.004508 -0.009016 -0.01541 -0.01827]), struct(
  case="TOTAL: TOTAL: UAV",
  mach=0.05,
  alt=100,
  alpha=[-14 -12 -10 -8 -6 -5 -4 -2 -1 0 1 2 4 5 8 10 12 14 16 18],
  nmach=1,
  nalt=1,
  nalpha=20,
  rnnub=[],
  hypers=false,
  loop=1,
  sref=3.561,
  cbar=0.613,
  blref=5.91,
  dim="ft",
  deriv="deg",
  stmach=0.6,
  tsmach=1.4,
  save=false,
  stype=[],
  trim=false,
  damp=true,
  build=1,
  part=false,
  highsym=true,
  highasy=false,
  highcon=false,
  tjet=false,
  hypeff=false,
  lb=false,
  pwr=false,
  grnd=false,
  wsspn=2.6575,
  hsspn=0.656,
  ndelta=8,
  delta=[-15 -10 -5 0 5 10 13 16],
  deltal=[],
  deltar=[],
  ngh=0,
  grndht=[],
  config=struct(downwash=true, body=true, wing=true, htail=true, vtail=true, vfin=false),
  version=1976,
  cd=[0.087; 0.065; 0.048; 0.036; 0.028; 0.025; 0.024; 0.023; 0.024; 0.027; 0.03; 0.035; 0.047; 0.055; 0.087; 0.112; 0.136; 0.158; 0.177; 0.181],
  cl=[-1.052; -0.845; -0.641; -0.441; -0.246; -0.151; -0.058; 0.128; 0.225; 0.323; 0.423; 0.525; 0.733; 0.84; 1.163; 1.364; 1.524; 1.654; 1.747; 1.735],
  cm=[0.2234; 0.1939; 0.1645; 0.1347; 0.1024; 0.0854; 0.0682; 0.0342; 0.0165; 0.0014; -0.0118; -0.0242; -0.0523; -0.0674; -0.1152; -0.1507; -0.1961; -0.2515; -0.3172; -0.35],
  cn=[-1.041; -0.84; -0.64; -0.441; -0.247; -0.152; -0.06; 0.127; 0.225; 0.323; 0.424; 0.526; 0.735; 0.841; 1.164; 1.363; 1.519; 1.643; 1.729; 1.706],
  ca=[-0.17; -0.112; -0.064; -0.026; 0.002; 0.012; 0.019; 0.028; 0.028; 0.027; 0.023; 0.016; -0.004; -0.018; -0.076; -0.126; -0.183; -0.246; -0.311; -0.364],
  xcp=[-0.215; -0.231; -0.257; -0.305; -0.414; -0.56; -1.146; 0.269; 0.074; 0.004; -0.028; -0.046; -0.071; -0.08; -0.099; -0.111; -0.129; -0.153; -0.184; NaN],
  cma=[-0.003166; -0.01473; -0.01479; -0.01553; -0.01673; -0.01709; -0.01711; -0.01746; -0.01642; -0.01415; -0.01278; -0.01297; -0.01471; -0.01526; -0.01701; -0.02021; -0.02521; -0.03028; -0.03545; -0.041],
  cyb=repmat(-0.002563, 20, 1),
  cnb=repmat(0.003032, 20, 1),
  clb=[-0.000324; -0.0003746; -0.000427; -0.0004787; -0.0005276; -0.0005508; -0.0005731; -0.0006173; -0.0006405; -0.0006644; -0.0006889; -0.0007143; -0.000767; -0.0007942; -0.0008781; -0.0009285; -0.0009614; -0.0009793; -0.0009805; -0.0009382],
  cla=[0.1017; 0.1026; 0.1011; 0.09879; 0.09577; 0.09389; 0.09293; 0.0956; 0.09765; 0.09921; 0.1008; 0.1025; 0.1056; 0.1066; 0.1035; 0.09019; 0.07238; 0.05582; 0.02032; -0.03252],
  qqinf=[1; 1; 1; 1; 1; 1; 1; 0.989; 0.959; 0.931; 0.925; 0.945; 0.998; 1; 1; 1; 1; 1; 1; 1],
  eps=[-3.693; -2.999; -2.27; -1.538; -0.81; -0.45; -0.093; 0.633; 1.015; 1.402; 1.784; 2.166; 2.937; 3.324; 4.456; 5.156; 5.732; 6.128; 6.388; 6.388],
  depsdalp=[0.347; 0.356; 0.365; 0.365; 0.361; 0.358; 0.359; 0.376; 0.384; 0.384; 0.382; 0.383; 0.386; 0.385; 0.361; 0.319; 0.243; 0.164; 0.065; 0],
  clq=repmat(0.08016, 20, 1),
  cmq=repmat(-0.2083, 20, 1),
  clad=[0.01694; 0.01737; 0.01784; 0.01783; 0.01764; 0.01751; 0.01755; 0.01816; 0.018; 0.01747; 0.01725; 0.01767; 0.01883; 0.01878; 0.01762; 0.01558; 0.01187; 0.008012; 0.003176; -4.053e-6],
  cmad=[-0.07091; -0.07272; -0.07471; -0.07466; -0.07385; -0.07331; -0.07347; -0.07602; -0.07536; -0.07317; -0.07224; -0.074; -0.07886; -0.07865; -0.07379; -0.06522; -0.04971; -0.03355; -0.0133; 1.697e-5],
  clp=[-0.009647; -0.009512; -0.009338; -0.009081; -0.008752; -0.008559; -0.008465; -0.008709; -0.00893; -0.009133; -0.009319; -0.009483; -0.00976; -0.009866; -0.009577; -0.00828; -0.006508; -0.004854; -0.001383; 0.003767],
  cyp=[0.0004117; 0.0002971; 0.000186; 7.937e-5; -2.227e-5; -7.108e-5; -0.0001184; -0.0002131; -0.0002627; -0.0003135; -0.0003655; -0.0004186; -0.0005281; -0.0005845; -0.0007683; -0.0009042; -0.001024; -0.001126; -0.001285; -0.001346],
  cnp=[0.00115; 0.0009323; 0.0007168; 0.0005038; 0.0002916; 0.0001852; 7.828e-5; -0.0001353; -0.0002426; -0.0003491; -0.0004557; -0.0005623; -0.0007774; -0.0008868; -0.001273; -0.00164; -0.002038; -0.002411; -0.002933; -0.003089],
  cnr=[-0.001016; -0.0009397; -0.0008844; -0.0008493; -0.0008334; -0.000832; -0.0008347; -0.0008516; -0.0008663; -0.0008856; -0.0009097; -0.0009391; -0.001014; -0.00106; -0.001232; -0.001362; -0.001475; -0.00157; -0.001634; -0.001598],
  clr=[-0.003476; -0.002732; -0.001998; -0.001281; -0.0005872; -0.0002513; 7.637e-5; 0.0007335; 0.001076; 0.001427; 0.001785; 0.002151; 0.002899; 0.00328; 0.004442; 0.005157; 0.005705; 0.006129; 0.006406; 0.006265],
  dcl_sym=[-0.048; -0.033; -0.016; 0; 0.016; 0.033; 0.042; 0.051],
  dcm_sym=[0.2775; 0.1896; 0.0948; -0.0002; -0.0948; -0.1896; -0.244; -0.2925],
  dclmax_sym=[0.057; 0.041; 0.021; 0; 0.021; 0.041; 0.05; 0.06],
  dcdmin_sym=[0.0022; 0.0009; 0.00045; 0; 0.00045; 0.0009; 0.00168; 0.0025],
  clad_sym=repmat(NaN, 8, 1),
  cha_sym=[-0.003166; 99999; 99999; 99999; 99999; 99999; 99999; 99999],
  chd_sym=[-0.01248; -0.01242; -0.01242; -0.01242; -0.01242; -0.01242; -0.01244; -0.01251],
  dcdi_sym=[0.00755 0.00455 0.00195 -3.26e-6 -0.00131 -0.00197 -0.00207 -0.00197
   0.0066 0.0039 0.00163 -2.61e-6 -0.000985 -0.00133 -0.00123 -0.000962
   0.00567 0.00327 0.00131 -1.98e-6 -0.000669 -0.000694 -0.000414 1.35e-5
   0.00475 0.00264 0.000998 -1.35e-6 -0.000354 -6.4e-5 0.000397 0.000987
   0.00382 0.00201 0.000682 -7.19e-7 -3.8e-5 0.000568 0.00121 0.00196
   0.00336 0.00169 0.000523 -4.01e-7 0.000121 0.000886 0.00162 0.00246
   0.00289 0.00137 0.000363 -8.14e-8 0.000281 0.00121 0.00203 0.00295
   0.00196 0.000738 4.7e-5 5.51e-7 0.000597 0.00184 0.00285 0.00393
   0.00151 0.000431 -0.000106 8.58e-7 0.000751 0.00215 0.00324 0.0044
   0.00107 0.000126 -0.000259 1.16e-6 0.000903 0.00245 0.00364 0.00487
   0.000616 -0.00018 -0.000412 1.47e-6 0.00106 0.00276 0.00403 0.00535
   0.000165 -0.000488 -0.000566 1.78e-6 0.00121 0.00306 0.00443 0.00582
   -0.00073 -0.0011 -0.000871 2.39e-6 0.00152 0.00367 0.00522 0.00676
   -0.00118 -0.0014 -0.00102 2.69e-6 0.00167 0.00398 0.00561 0.00724
   -0.00254 -0.00233 -0.00149 3.62e-6 0.00213 0.00491 0.0068 0.00867
   -0.00348 -0.00298 -0.00181 4.27e-6 0.00245 0.00555 0.00764 0.00967
   -0.00452 -0.00368 -0.00216 4.98e-6 0.00281 0.00626 0.00855 0.0108
   -0.00569 -0.00448 -0.00256 5.77e-6 0.00321 0.00706 0.00958 0.012
   -0.00696 -0.00535 -0.00299 6.63e-6 0.00364 0.00792 0.0107 0.0133
   -0.00841 -0.00634 -0.00349 7.63e-6 0.00414 0.00892 0.012 0.0149])}

initConditions = struct(x0=[0 0 50], v0=[14 0 0], euler0=[0 0 0], w0=[0 0 0])